# Grasshopper definition Ack1.gh (Grasshopper 0.9.64)
# plug-ins: Python Interpreter

geo = Geometry(<brep referenced from the Rhino model>)
pt = Point(<point referenced from the Rhino model>)
pt_2 = Point(<point referenced from the Rhino model>)
rad = Radians(Degrees=Slider(-1, range=-15..15))
mirror = Mirror(Geometry=geo, Plane=PlaneYZ(0, 0, 0))  # -> Geometry, Transform
mirror_2 = Mirror(Geometry=pt, Plane=PlaneYZ(0, 0, 0))  # -> Geometry, Transform
W = Number(300)
T = Number(184)
mirror_3 = Mirror(Geometry=pt_2, Plane=PlaneYZ(0, 0, 0))  # -> Geometry, Transform
num = Number(0.5)
python = PythonScript(T=T, W=W, a=rad)  # -> out, b
# ---------- python: Python ----------
import math
tbyw = T/W
print tbyw

if(a == 0.0):
    print "a = 0"
    b = 0.0
else:
    tan_a = math.tan(a)
    tan_b = 1.0/(tbyw + 1.0/tan_a)
    b = math.atan(tan_b)
    print b
    print math.degrees(math.atan(1))
# ---------- end python ----------
pt_3 = Point(mirror_2.Geometry)
pt_4 = Point(mirror_3.Geometry)
rotate = Rotate(Geometry=pt_2, Angle=rad, Plane=pt)  # -> Geometry, Transform
deg = Degrees(Radians=python.b)
rotate_2 = Rotate(Geometry=pt_4, Angle=python.b, Plane=pt_3)  # -> Geometry, Transform
rotate_3 = Rotate(Geometry=geo, Angle=rad, Plane=pt)  # -> Geometry, Transform
rotate_4 = Rotate(Geometry=mirror.Geometry, Angle=python.b, Plane=pt_3)  # -> Geometry, Transform
yz = YZPlane(Origin=pt_2)
panel = Panel(deg)
ln = Line(StartPoint=rotate.Geometry, EndPoint=rotate_2.Geometry)
cir = Circle(Plane=yz, Radius=3)
len = Length(Curve=ln)
panel_2 = Panel(len)
extrcrv = ExtrudeAlong(Base=cir, Curve=ln)
